# Grasshopper definition SUOtoGH SalesID and GUI.gh (Grasshopper 1.0.7)
# plug-ins: Swiftlet, Human UI

# Has to be made protection against not writing anything - program will crash
create_text_box = CreateTextBox(Label="Name of Customer", DefaultText="none", UpdateButton=True, showLabel=True)
create_pulldown_menu = CreatePulldownMenu(Label="E-conomic customer number:", ListItems="d", showLabel=True)
launch_window = LaunchWindow(Show=Toggle(True), Name="Control Window", Width=370, Height=400, ChildStatus=0, EnableHorizScroll=False)
value_listener = ValueListener(Elements=flatten(create_pulldown_menu), SomeProperty=True)  # -> Values, Indices
value_listener_2 = ValueListener(Elements=create_text_box, SomeProperty=True)  # -> Values, Indices
panel = Panel(value_listener.Indices)
concatenate = Concatenate(Fragment_A="name begins ", Fragment_B="'", A=value_listener_2.Values, B="'")
concatenate_2 = Concatenate(FragmentA="8A:Cust29326.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", FragmentB="Accept:application/json")
bearer_token_auth = BearerTokenAuth(Token=concatenate_2)
create_query_param = CreateQueryParam(Key="$filter", Value=concatenate)
create_query_param_2 = CreateQueryParam(Key="$select", Value="contactId")
create_query_param_3 = CreateQueryParam(Key="$select", Value="UserDefinedFields")
create_query_param_4 = CreateQueryParam(Key="$select", Value="saleId")
merge = Merge(Data1=create_query_param, Data2=create_query_param_2)
get_request = GETRequest(URL="https://online4.superoffice.com/Cust29326/api/v1/Contact", Params=merge, Headers=bearer_token_auth)  # -> Status, Content, Response
panel_2 = Panel(get_request.Status)
format_json_string = FormatJsonString(JSONString=get_request.Content)
panel_3 = Panel(format_json_string)
ghpython_script = GhPythonScript(x=panel_3)  # -> out, a
# ---------- ghpython_script: Python ----------
__author__ = "AndShufl"
__version__ = "2023.11.22"

import rhinoscriptsyntax as rs
import json

json_input = x
import json

def extract_contact_ids(json_string):
    # Parse the JSON string
    data = json.loads(json_string)

    # Extract saleIds from the "value" array
    contact_ids = [item["contactId"] for item in data["value"]]

    return contact_ids
# Extract saleIds
result = extract_contact_ids(json_input)

# Print each saleId on a separate line
for contact_id in result:
    print(contact_id)
# ---------- end ghpython_script ----------
customer_id = Panel(ghpython_script.out)
create_pulldown_menu_2 = CreatePulldownMenu(Label="Customer ID: ", ListItems=customer_id, showLabel=True)
value_listener_3 = ValueListener(Elements=flatten(create_pulldown_menu_2), SomeProperty=True)  # -> Values, Indices
construct_path = ConstructPath(Indices=value_listener_3.Indices)
panel_4 = Panel(construct_path)
create_pulldown_menu_3 = CreatePulldownMenu(Label="Sales ID: ", ListItems="d", SelectedIndex=value_listener_3.Indices, showLabel=True)
entwine = Entwine(
    Branch00=create_text_box,
    Branch01=create_pulldown_menu_2,
    Branch02=create_pulldown_menu,
    Branch03=create_pulldown_menu_3,
    FlattenInputs=True)
add_elements = AddElements(Window=launch_window, Elements=flatten(entwine), DoVLChecking=True)  # -> AddedElements, ElementNames
value_listener_4 = ValueListener(Elements=create_pulldown_menu_3, SomeProperty=True)  # -> Values, Indices
value_to_forward_to_ghtosuo = Panel(value_listener_4.Values)
concatenate_3 = Concatenate(FragmentA="https://online4.superoffice.com/Cust29326/api/v1/Contact/", FragmentB=customer_id)
concatenate_4 = Concatenate(FragmentA=customer_id, FragmentB="/Sales")
concatenate_5 = Concatenate(FragmentA="https://online4.superoffice.com/Cust29326/api/v1/Contact/", FragmentB=concatenate_4)
get_request_2 = GETRequest(URL=concatenate_3, Params=create_query_param_3, Headers=bearer_token_auth)  # -> Status, Content, Response
get_request_3 = GETRequest(URL=concatenate_5, Params=create_query_param_4, Headers=bearer_token_auth)  # -> Status, Content, Response
panel_5 = Panel(get_request_2.Status)
format_json_string_2 = FormatJsonString(JSONString=get_request_2.Content)
format_json_string_3 = FormatJsonString(JSONString=get_request_3.Content)
panel_6 = Panel(get_request_3.Status)
panel_7 = Panel(format_json_string_2)
panel_8 = Panel(format_json_string_3)
ghpython_script_2 = GhPythonScript(x=panel_7)  # -> flatten(out), a
# ---------- ghpython_script_2: Python ----------
__author__ = "AndShufl"
__version__ = "2023.11.22"

import rhinoscriptsyntax as rs
import json

json_input=x
def extract_customerno(json_string):
    # Parse the JSON string
    data = json.loads(json_string)

    # Extract the value of "economic:customerno" from "UserDefinedFields"
    customerno = data.get("UserDefinedFields", {}).get("economic:customerno", None)

    return customerno
# Extract the value of "economic:customerno"
result = extract_customerno(json_input)

# Print the result
print(result)
# ---------- end ghpython_script_2 ----------
e_conomic_customer_number = Panel(ghpython_script_2.out)
list_item = ListItem(List=e_conomic_customer_number, Index=value_listener_3.Indices, Wrap=True)
panel_9 = Panel(list_item)
set_list_contents = SetListContents(ListToModify=create_pulldown_menu, NewListContents=list_item)
ghpython_script_3 = GhPythonScript(x=panel_8)  # -> simplify(out), a
# ---------- ghpython_script_3: Python ----------
__author__ = "AndShufl"
__version__ = "2023.11.22"

import rhinoscriptsyntax as rs
import json

json_input = x
import json

def extract_sale_ids(json_string):
    # Parse the JSON string
    data = json.loads(json_string)

    # Extract saleIds from the "value" array
    sale_ids = [item["saleId"] for item in data["value"]]

    return sale_ids
# Extract saleIds
result = extract_sale_ids(json_input)

# Print each saleId on a separate line
for sale_id in result:
    print(sale_id)
# ---------- end ghpython_script_3 ----------
sales_id = Panel(ghpython_script_3.out)
split_tree = SplitTree(Data=sales_id, Masks=flatten(construct_path))  # -> Positive, Negative
panel_10 = Panel(split_tree.Positive)
set_list_contents_2 = SetListContents(ListToModify=create_pulldown_menu_3, NewListContents=split_tree.Positive)
panel_11 = Panel(ghpython_script_3.out)
