# Grasshopper definition SUOtoGH_WindowSearchSalebyName.gh (Grasshopper 1.0.7)
# plug-ins: Swiftlet, Human UI

launch_window = LaunchWindow(Show=Toggle(False), Name="Control Window", Width=370, Height=400, ChildStatus=0, EnableHorizScroll=False)
create_text_box = CreateTextBox(Label="Search name", UpdateButton=True, showLabel=True)
add_elements = AddElements(Window=launch_window, Elements=flatten(create_text_box), DoVLChecking=True)  # -> AddedElements, ElementNames
value_listener = ValueListener(Elements=create_text_box, SomeProperty=True)  # -> Values, Indices
panel = Panel(value_listener.Values)
concatenate = Concatenate(Fragment_A="name begins ", Fragment_B="'", A="Martin Pet", B="'")
concatenate_2 = Concatenate(FragmentA="8A:Cust29326.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", FragmentB="Accept:application/json")
bearer_token_auth = BearerTokenAuth(Token=concatenate_2)
create_query_param = CreateQueryParam(Key="$filter", Value=concatenate)
create_query_param_2 = CreateQueryParam(Key="$select", Value="contactId")
create_query_param_3 = CreateQueryParam(Key="$select", Value="UserDefinedFields")
create_query_param_4 = CreateQueryParam(Key="$select", Value="saleId")
merge = Merge(Data1=create_query_param, Data2=create_query_param_2)
get_request = GETRequest(URL="https://online4.superoffice.com/Cust29326/api/v1/Contact", Params=merge, Headers=bearer_token_auth)  # -> Status, Content, Response
panel_2 = Panel(get_request.Status)
format_json_string = FormatJsonString(JSONString=get_request.Content)
panel_3 = Panel(format_json_string)
ghpython_script = GhPythonScript(x=panel_3)  # -> out, a
# ---------- ghpython_script: Python ----------
__author__ = "AndShufl"
__version__ = "2023.11.22"

import rhinoscriptsyntax as rs
import json

json_input = x
import json

def extract_contact_ids(json_string):
    # Parse the JSON string
    data = json.loads(json_string)

    # Extract saleIds from the "value" array
    contact_ids = [item["contactId"] for item in data["value"]]

    return contact_ids
# Extract saleIds
result = extract_contact_ids(json_input)

# Print each saleId on a separate line
for contact_id in result:
    print(contact_id)
# ---------- end ghpython_script ----------
customer_id = Panel(ghpython_script.out)
concatenate_3 = Concatenate(FragmentA="https://online4.superoffice.com/Cust29326/api/v1/Contact/", FragmentB=customer_id)
concatenate_4 = Concatenate(FragmentA=customer_id, FragmentB="/Sales")
concatenate_5 = Concatenate(FragmentA="https://online4.superoffice.com/Cust29326/api/v1/Contact/", FragmentB=concatenate_4)
get_request_2 = GETRequest(URL=concatenate_3, Params=create_query_param_3, Headers=bearer_token_auth)  # -> Status, Content, Response
get_request_3 = GETRequest(URL=concatenate_5, Params=create_query_param_4, Headers=bearer_token_auth)  # -> Status, Content, Response
panel_4 = Panel(get_request_2.Status)
format_json_string_2 = FormatJsonString(JSONString=get_request_2.Content)
format_json_string_3 = FormatJsonString(JSONString=get_request_3.Content)
panel_5 = Panel(get_request_3.Status)
panel_6 = Panel(format_json_string_2)
panel_7 = Panel(format_json_string_3)
ghpython_script_2 = GhPythonScript(x=panel_6)  # -> flatten(out), a
# ---------- ghpython_script_2: Python ----------
__author__ = "AndShufl"
__version__ = "2023.11.22"

import rhinoscriptsyntax as rs
import json

json_input=x
def extract_customerno(json_string):
    # Parse the JSON string
    data = json.loads(json_string)

    # Extract the value of "economic:customerno" from "UserDefinedFields"
    customerno = data.get("UserDefinedFields", {}).get("economic:customerno", None)

    return customerno
# Extract the value of "economic:customerno"
result = extract_customerno(json_input)

# Print the result
print(result)
# ---------- end ghpython_script_2 ----------
ghpython_script_3 = GhPythonScript(x=panel_7)  # -> simplify(out), a
# ---------- ghpython_script_3: Python ----------
__author__ = "AndShufl"
__version__ = "2023.11.22"

import rhinoscriptsyntax as rs
import json

json_input = x
import json

def extract_sale_ids(json_string):
    # Parse the JSON string
    data = json.loads(json_string)

    # Extract saleIds from the "value" array
    sale_ids = [item["saleId"] for item in data["value"]]

    return sale_ids
# Extract saleIds
result = extract_sale_ids(json_input)

# Print each saleId on a separate line
for sale_id in result:
    print(sale_id)
# ---------- end ghpython_script_3 ----------
e_conomic_customer_number = Panel(ghpython_script_2.out)
sales_id = Panel(ghpython_script_3.out)
