# Grasshopper definition GHtoSUO_GUI_Sales_Records_AFTER THE IF_DIDNT WORK.gh (Grasshopper 1.0.7)
# plug-ins: Swiftlet, Human UI

_107 = Panel("""(No Selection);I:0
Stål;I:115
Malet - Brancusi White;I:151
Malet - Hammershoi Light Grey;I:150
Malet - Miami Lemon;I:155
Malet - Miami Ocean;I:153
Malet - Miami Peach;I:154
Malet - Miami Sky;I:152""")
_117 = Panel("""(No Selection);I:0
Fremvisning;I:163
Online;I:164
UA;I:162
Ingen fremvisning ;I:165""")
_120 = Panel("""(No Selection);I:0
Røget eg;I:206
Eg;I:207""")
_105 = Panel("""(No Selection);I:0
&SHUFL;I:40
&SHUFL IHP;I:41
IKEA IHP;I:42
Kundens egen tegning;I:43
Ingen;I:44""")
_109 = Panel("""(No Selection);I:0
Elm;I:62""")
_116 = Panel("""(No Selection);I:0
Elm;I:159
Eg;I:160
Røget eg;I:161
Sort;I:208
Ask;I:209
Core;I:210""")
_103 = Panel("""(No Selection);I:0
BA Dark;I:119
BA Light;I:120
BA Middle;I:121
LA Blaze Red;I:187
LA China Blue;I:170
LA Clementine;I:186
LA Eldorado (udgået);I:169
LA Fox;I:171
LA Just Gold;I:185
LA Just Rose;I:173
LA New Magnolia (Udgået);I:168
LA Opal;I:182
LA Oyster grey;I:166
LA Pale Gold;I:183
LA Porcelana;I:188
LA Tenere;I:184
LA Teracotta;I:172
LI Ash;I:111
LI Charcoal;I:73
LI Iron;I:167
LI Mauve;I:117
PA Flavin Pale Yellow;I:180
PA Miami Lemon;I:136
PA Miami Light Blue;I:148
PA Miami Mint;I:147
PA Miami Ocean;I:138
PA Miami Peach;I:137
PA Miami Sky;I:139
PA Valadon Brown;I:146
PA Whiteread Warm Grey;I:181
SP Specialfarve;I:140
FE Nero Ingo;I:198
FE Blu Fes;I:199
FE Grigio Londra;I:200
FE Bianco Cos;I:201
FE Castoro Ottawa;I:202
FE Verde Comodoro;I:203
FE Azzurro Naxos;I:204
FE Grigio Efeso;I:205""")
_99 = Panel("""(No Selection);I:0
Metod;I:11
Godmorgon;I:10
Pax;I:51
Faktum;I:50
Andet;I:52
HTH;I:175
Svane;I:176
Kvik;I:177
Designa;I:178
Invita;I:179""")
_106 = Panel("""(No Selection);I:0
Linoleum;I:46
Laminat;I:45
Painted;I:47
Wood;I:48
Raw;I:49
Bambus (arb.titel);I:118
Fenix;I:189""")
create_button = CreateButton(ButtonName="Send to SUO", ButtonStyle=0)
adjust_element_appearance = AdjustElementAppearance(ElementsToAdjust=create_button, FontSize="13")
value_listener = ValueListener(Elements=create_button, SomeProperty=True)  # -> Values, Indices
cluster = Cluster(input_list_data=_106)  # -> text_for_user, data_for_json
cluster_2 = Cluster(input_list_data=_103)  # -> text_for_user, data_for_json
cluster_3 = Cluster(input_list_data=_106)  # -> text_for_user, data_for_json
cluster_4 = Cluster(input_list_data=_103)  # -> text_for_user, data_for_json
cluster_5 = Cluster(input_list_data=_103)  # -> text_for_user, data_for_json
cluster_6 = Cluster(input_list_data=_99)  # -> text_for_user, data_for_json
cluster_7 = Cluster(input_list_data=_109)  # -> text_for_user, data_for_json
cluster_8 = Cluster(input_list_data=_120)  # -> text_for_user, data_for_json
cluster_9 = Cluster(input_list_data=_105)  # -> text_for_user, data_for_json
cluster_10 = Cluster(input_list_data=_99)  # -> text_for_user, data_for_json
cluster_11 = Cluster(input_list_data=_106)  # -> text_for_user, data_for_json
cluster_12 = Cluster(input_list_data=_107)  # -> text_for_user, data_for_json
cluster_13 = Cluster(input_list_data=_116)  # -> text_for_user, data_for_json
cluster_14 = Cluster(input_list_data=_117)  # -> text_for_user, data_for_json
cluster_15 = Cluster(input_list_data=_116)  # -> text_for_user, data_for_json
panel = Panel(value_listener.Values)
create_pulldown_menu = CreatePulldownMenu(Label="System 2:", ListItems="d", showLabel=True)
create_pulldown_menu_2 = CreatePulldownMenu(Label="Kollektion 3:", ListItems="d", showLabel=True)
create_pulldown_menu_3 = CreatePulldownMenu(Label="Farve 1:", ListItems="d", showLabel=True)
create_pulldown_menu_4 = CreatePulldownMenu(Label="Farve 3:", ListItems="d", showLabel=True)
create_pulldown_menu_5 = CreatePulldownMenu(Label="Trækanter kol 1:", ListItems="d", showLabel=True)
create_pulldown_menu_6 = CreatePulldownMenu(Label="Kollektion 1:", ListItems="d", showLabel=True)
create_pulldown_menu_7 = CreatePulldownMenu(Label="Farve 2:", ListItems="d", showLabel=True)
create_pulldown_menu_8 = CreatePulldownMenu(Label="Trækanter kol 2:", ListItems="d", showLabel=True)
create_pulldown_menu_9 = CreatePulldownMenu(Label="System 1:", ListItems="d", showLabel=True)
create_pulldown_menu_10 = CreatePulldownMenu(Label="Kollektion 2:", ListItems="d", showLabel=True)
create_pulldown_menu_11 = CreatePulldownMenu(Label="Greb:", ListItems="d", showLabel=True)
create_pulldown_menu_12 = CreatePulldownMenu(Label="Tegning:", ListItems="d", showLabel=True)
create_checkbox = CreateCheckbox(Label="Ekstern bordplade", StartingValue=False)
create_checkbox_2 = CreateCheckbox(Label="Træskuffer", StartingValue=False)
create_checkbox_3 = CreateCheckbox(Label="Quooker", StartingValue=False)
create_checkbox_4 = CreateCheckbox(Label="Vask", StartingValue=False)
create_pulldown_menu_13 = CreatePulldownMenu(Label="Træskuffetype:", ListItems="d", showLabel=True)
create_text_box = CreateTextBox(Label="Andet:", UpdateButton=False, showLabel=True)
create_text_box_2 = CreateTextBox(Label="Antal skruepakker:", DefaultText="0", UpdateButton=False, showLabel=True)
create_checkbox_5 = CreateCheckbox(Label="Plejemiddel", StartingValue=False)
create_text_box_3 = CreateTextBox(Label="&SHUFL fakturanummer:", UpdateButton=False, showLabel=True)
create_text_box_4 = CreateTextBox(Label="&SHUFL ordrenummer:", UpdateButton=False, showLabel=True)
create_checkbox_6 = CreateCheckbox(Label="Fejl i ordre fra prod", StartingValue=False)
create_checkbox_7 = CreateCheckbox(Label="Godkendt", StartingValue=False)
create_text_box_5 = CreateTextBox(Label="Produktionskapacitet", UpdateButton=False, showLabel=True)
create_text_box_6 = CreateTextBox(Label="Leverandør ordrenummer:", UpdateButton=False, showLabel=True)
create_text_box_7 = CreateTextBox(Label="Max dimensioner i ordren:", UpdateButton=False, showLabel=True)
create_text_box_8 = CreateTextBox(Label="Leveringsdato aftalt med kunden ved køb:", UpdateButton=False, showLabel=True)
create_pulldown_menu_14 = CreatePulldownMenu(Label="Greb indlæg:", ListItems="d", showLabel=True)
create_text_box_9 = CreateTextBox(Label="Antal dele:", DefaultText="0", UpdateButton=False, showLabel=True)
create_pulldown_menu_15 = CreatePulldownMenu(Label="Fremvisning:", ListItems="d", showLabel=True)
# Create a panel that can look like Sales/More in SUO.
# The names of entities are assigned with JSON ID of entity: example: SuperOffice:13
# The mapping is in the file
# How to add more records to the JSON file string while choosing many entities simuntaneously?
# Programming logic ?(IF record THEN add)
# In the panel you can choose for each entity a list of Colors/Material/etc.
# There are files translating each color to ID for JSON, each entity has its file, some entities use same file.
# How to make it possible that to Farve is going different set?
panel_2 = Panel("8A:Cust29326.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")
open_the_window = BooleanToggle(True)
launch_window = LaunchWindow(
    Show=open_the_window,
    Name="Bumblebee &SHUFL - Send to SUO",
    Width="500",
    Height="1190",
    ChildStatus=2,
    EnableHorizScroll=False)
merge = Merge(
    Data1=create_text_box_4,
    Data2=create_text_box_6,
    Data3=create_checkbox_7,
    Data4=create_checkbox_6,
    Data5=create_text_box_9,
    Data6=create_text_box_7,
    Data7=create_text_box_8,
    Data8=create_pulldown_menu_15,
    Data9=create_pulldown_menu_14)
set_textbox_contents = SetTextBoxContents(TextBoxToModify=create_text_box_5)
set_list_contents = SetListContents(ListToModify=create_pulldown_menu_4, NewListContents=cluster_5.text_for_user)
set_textbox_contents_2 = SetTextBoxContents(TextBoxToModify=create_text_box_2)
set_list_contents_2 = SetListContents(ListToModify=create_pulldown_menu_6, NewListContents=cluster.text_for_user)
set_list_contents_3 = SetListContents(ListToModify=create_pulldown_menu_3, NewListContents=cluster_2.text_for_user)
set_list_contents_4 = SetListContents(ListToModify=create_pulldown_menu_10, NewListContents=cluster_3.text_for_user)
set_textbox_contents_3 = SetTextBoxContents(TextBoxToModify=create_text_box_3)
set_list_contents_5 = SetListContents(ListToModify=create_pulldown_menu_9, NewListContents=cluster_6.text_for_user)
set_list_contents_6 = SetListContents(ListToModify=create_pulldown_menu, NewListContents=cluster_10.text_for_user)
set_list_contents_7 = SetListContents(ListToModify=create_pulldown_menu_7, NewListContents=cluster_4.text_for_user)
set_textbox_contents_4 = SetTextBoxContents(TextBoxToModify=create_text_box_4)
set_textbox_contents_5 = SetTextBoxContents(TextBoxToModify=create_text_box_6)
set_list_contents_8 = SetListContents(ListToModify=create_pulldown_menu_12, NewListContents=cluster_9.text_for_user)
set_list_contents_9 = SetListContents(ListToModify=create_pulldown_menu_2, NewListContents=cluster_11.text_for_user)
set_checkbox = SetCheckBox(CheckBoxToModify=create_checkbox_2)
set_textbox_contents_6 = SetTextBoxContents(TextBoxToModify=create_text_box_9)
set_checkbox_2 = SetCheckBox(CheckBoxToModify=create_checkbox)
set_list_contents_10 = SetListContents(ListToModify=create_pulldown_menu_11, NewListContents=cluster_12.text_for_user)
set_textbox_contents_7 = SetTextBoxContents(TextBoxToModify=create_text_box_7)
set_textbox_contents_8 = SetTextBoxContents(TextBoxToModify=create_text_box)
set_textbox_contents_9 = SetTextBoxContents(TextBoxToModify=create_text_box_8)
set_checkbox_3 = SetCheckBox(CheckBoxToModify=create_checkbox_3)
set_checkbox_4 = SetCheckBox(CheckBoxToModify=create_checkbox_7)
set_checkbox_5 = SetCheckBox(CheckBoxToModify=create_checkbox_4)
set_checkbox_6 = SetCheckBox(CheckBoxToModify=create_checkbox_6)
set_list_contents_11 = SetListContents(ListToModify=create_pulldown_menu_15, NewListContents=cluster_14.text_for_user)
set_checkbox_7 = SetCheckBox(CheckBoxToModify=create_checkbox_5)
set_list_contents_12 = SetListContents(ListToModify=create_pulldown_menu_5, NewListContents=cluster_15.text_for_user)
set_list_contents_13 = SetListContents(ListToModify=create_pulldown_menu_14, NewListContents=cluster_8.text_for_user)
set_list_contents_14 = SetListContents(ListToModify=create_pulldown_menu_8, NewListContents=cluster_13.text_for_user)
set_list_contents_15 = SetListContents(ListToModify=create_pulldown_menu_13, NewListContents=cluster_7.text_for_user)
create_text_block = CreateTextBlock(TextSize=12, Justification=0)
point = Point("1000,15")
merge_2 = Merge(
    Data1=create_pulldown_menu_12,
    Data2=create_pulldown_menu_9,
    Data3=create_pulldown_menu,
    Data4=create_pulldown_menu_6,
    Data5=create_pulldown_menu_3,
    Data6=create_pulldown_menu_10,
    Data7=create_pulldown_menu_7,
    Data8=create_pulldown_menu_2,
    Data9=create_pulldown_menu_4,
    Data10=create_pulldown_menu_11,
    Data11=create_pulldown_menu_5,
    Data12=create_pulldown_menu_8)
merge_3 = Merge(
    Data1=create_text_box_5,
    Data2=merge_2,
    Data3=create_checkbox_2,
    Data4=create_checkbox,
    Data5=create_checkbox_3,
    Data6=create_checkbox_4,
    Data7=create_text_box,
    Data8=create_checkbox_5,
    Data9=create_pulldown_menu_13,
    Data10=create_text_box_2,
    Data11=create_text_box_3,
    Data12=merge,
    Data13=create_button)
add_elements = AddElements(Window=launch_window, Elements=flatten(merge_3), DoVLChecking=True)  # -> AddedElements, ElementNames
set_window_properties = SetWindowProperties(
    Window=launch_window,
    StartingLocation=point,
    Theme="1",
    ShowTitleBar=True,
    BackgroundColor="#483C32",
    ScaleFactor=Slider(1.01, range=0..2))
dispatch = Dispatch(List=create_text_box, DispatchPattern=value_listener.Values)  # -> ListA, ListB
dispatch_2 = Dispatch(List=create_checkbox_4, DispatchPattern=value_listener.Values)  # -> ListA, ListB
dispatch_3 = Dispatch(List=create_checkbox_3, DispatchPattern=value_listener.Values)  # -> ListA, ListB
dispatch_4 = Dispatch(List=create_checkbox_5, DispatchPattern=value_listener.Values)  # -> ListA, ListB
dispatch_5 = Dispatch(List=create_pulldown_menu_5, DispatchPattern=value_listener.Values)  # -> ListA, ListB
dispatch_6 = Dispatch(List=create_pulldown_menu_8, DispatchPattern=value_listener.Values)  # -> ListA, ListB
dispatch_7 = Dispatch(List=create_checkbox, DispatchPattern=value_listener.Values)  # -> ListA, ListB
dispatch_8 = Dispatch(List=create_checkbox_2, DispatchPattern=value_listener.Values)  # -> ListA, ListB
dispatch_9 = Dispatch(List=create_pulldown_menu_13, DispatchPattern=value_listener.Values)  # -> ListA, ListB
dispatch_10 = Dispatch(List=create_text_box_2, DispatchPattern=value_listener.Values)  # -> ListA, ListB
dispatch_11 = Dispatch(List=create_pulldown_menu_15, DispatchPattern=value_listener.Values)  # -> ListA, ListB
dispatch_12 = Dispatch(List=create_text_box_3, DispatchPattern=value_listener.Values)  # -> ListA, ListB
dispatch_13 = Dispatch(List=create_text_box_6, DispatchPattern=value_listener.Values)  # -> ListA, ListB
dispatch_14 = Dispatch(List=create_checkbox_6, DispatchPattern=value_listener.Values)  # -> ListA, ListB
dispatch_15 = Dispatch(List=create_text_box_9, DispatchPattern=value_listener.Values)  # -> ListA, ListB
dispatch_16 = Dispatch(List=create_pulldown_menu_14, DispatchPattern=value_listener.Values)  # -> ListA, ListB
dispatch_17 = Dispatch(List=create_text_box_8, DispatchPattern=value_listener.Values)  # -> ListA, ListB
dispatch_18 = Dispatch(List=create_pulldown_menu_11, DispatchPattern=value_listener.Values)  # -> ListA, ListB
dispatch_19 = Dispatch(List=create_checkbox_7, DispatchPattern=value_listener.Values)  # -> ListA, ListB
dispatch_20 = Dispatch(List=create_text_box_7, DispatchPattern=value_listener.Values)  # -> ListA, ListB
dispatch_21 = Dispatch(List=create_text_box_5, DispatchPattern=value_listener.Values)  # -> ListA, ListB
dispatch_22 = Dispatch(List=create_pulldown_menu_9, DispatchPattern=value_listener.Values)  # -> ListA, ListB
dispatch_23 = Dispatch(List=create_pulldown_menu_2, DispatchPattern=value_listener.Values)  # -> ListA, ListB
dispatch_24 = Dispatch(List=create_pulldown_menu_4, DispatchPattern=value_listener.Values)  # -> ListA, ListB
dispatch_25 = Dispatch(List=create_text_box_4, DispatchPattern=value_listener.Values)  # -> ListA, ListB
dispatch_26 = Dispatch(List=create_pulldown_menu_12, DispatchPattern=value_listener.Values)  # -> ListA, ListB
dispatch_27 = Dispatch(List=create_pulldown_menu_10, DispatchPattern=value_listener.Values)  # -> ListA, ListB
dispatch_28 = Dispatch(List=create_pulldown_menu_7, DispatchPattern=value_listener.Values)  # -> ListA, ListB
dispatch_29 = Dispatch(List=create_pulldown_menu_3, DispatchPattern=value_listener.Values)  # -> ListA, ListB
dispatch_30 = Dispatch(List=create_pulldown_menu, DispatchPattern=value_listener.Values)  # -> ListA, ListB
dispatch_31 = Dispatch(List=create_pulldown_menu_6, DispatchPattern=value_listener.Values)  # -> ListA, ListB
bearer_token_auth = BearerTokenAuth(Token=panel_2)
value_listener_2 = ValueListener(Elements=flatten(dispatch_27.ListA), SomeProperty=True)  # -> Values, Indices
value_listener_3 = ValueListener(Elements=flatten(dispatch_18.ListA), SomeProperty=True)  # -> Values, Indices
value_listener_4 = ValueListener(Elements=flatten(dispatch_24.ListA), SomeProperty=True)  # -> Values, Indices
value_listener_5 = ValueListener(Elements=flatten(dispatch_5.ListA), SomeProperty=True)  # -> Values, Indices
value_listener_6 = ValueListener(Elements=flatten(dispatch_28.ListA), SomeProperty=True)  # -> Values, Indices
value_listener_7 = ValueListener(Elements=flatten(dispatch_23.ListA), SomeProperty=True)  # -> Values, Indices
value_listener_8 = ValueListener(Elements=flatten(dispatch_6.ListA), SomeProperty=True)  # -> Values, Indices
value_listener_9 = ValueListener(Elements=flatten(dispatch_26.ListA), SomeProperty=True)  # -> Values, Indices
value_listener_10 = ValueListener(Elements=flatten(dispatch_22.ListA), SomeProperty=True)  # -> Values, Indices
value_listener_11 = ValueListener(Elements=flatten(dispatch_29.ListA), SomeProperty=True)  # -> Values, Indices
value_listener_12 = ValueListener(Elements=flatten(dispatch_31.ListA), SomeProperty=True)  # -> Values, Indices
value_listener_13 = ValueListener(Elements=dispatch_8.ListA, SomeProperty=True)  # -> Values, Indices
value_listener_14 = ValueListener(Elements=flatten(dispatch_30.ListA), SomeProperty=True)  # -> Values, Indices
value_listener_15 = ValueListener(Elements=dispatch.ListA, SomeProperty=True)  # -> Values, Indices
value_listener_16 = ValueListener(Elements=dispatch_4.ListA, SomeProperty=True)  # -> Values, Indices
value_listener_17 = ValueListener(Elements=dispatch_9.ListA, SomeProperty=True)  # -> Values, Indices
value_listener_18 = ValueListener(Elements=dispatch_3.ListA, SomeProperty=True)  # -> Values, Indices
value_listener_19 = ValueListener(Elements=dispatch_11.ListA, SomeProperty=True)  # -> Values, Indices
value_listener_20 = ValueListener(Elements=dispatch_7.ListA, SomeProperty=True)  # -> Values, Indices
value_listener_21 = ValueListener(Elements=dispatch_2.ListA, SomeProperty=True)  # -> Values, Indices
value_listener_22 = ValueListener(Elements=dispatch_10.ListA, SomeProperty=True)  # -> Values, Indices
value_listener_23 = ValueListener(Elements=dispatch_12.ListA, SomeProperty=True)  # -> Values, Indices
value_listener_24 = ValueListener(Elements=dispatch_25.ListA, SomeProperty=True)  # -> Values, Indices
value_listener_25 = ValueListener(Elements=dispatch_13.ListA, SomeProperty=True)  # -> Values, Indices
value_listener_26 = ValueListener(Elements=flatten(dispatch_21.ListA), SomeProperty=True)  # -> Values, Indices
value_listener_27 = ValueListener(Elements=dispatch_16.ListA, SomeProperty=True)  # -> Values, Indices
value_listener_28 = ValueListener(Elements=dispatch_19.ListA, SomeProperty=True)  # -> Values, Indices
value_listener_29 = ValueListener(Elements=dispatch_14.ListA, SomeProperty=True)  # -> Values, Indices
value_listener_30 = ValueListener(Elements=dispatch_15.ListA, SomeProperty=True)  # -> Values, Indices
value_listener_31 = ValueListener(Elements=dispatch_20.ListA, SomeProperty=True)  # -> Values, Indices
value_listener_32 = ValueListener(Elements=dispatch_17.ListA, SomeProperty=True)  # -> Values, Indices
create_query_param = CreateQueryParam(Key="$select", Value="UserDefinedFields")
concatenate = Concatenate(FragmentA="F:", FragmentB=value_listener_26.Values)
replace_members = ReplaceMembers(Set=concatenate, Find=",", Replace=".")
panel_3 = Panel(value_listener_31.Values)
panel_4 = Panel(replace_members)
cluster_16 = Cluster_2(ClusterInput=value_listener_9.Indices, data_for_json=cluster_9.data_for_json)
cluster_17 = Cluster_2(ClusterInput=value_listener_10.Indices, data_for_json=cluster_6.data_for_json)
cluster_18 = Cluster_2(ClusterInput=value_listener_14.Indices, data_for_json=cluster_10.data_for_json)
cluster_19 = Cluster_2(ClusterInput=value_listener_12.Indices, data_for_json=cluster.data_for_json)
cluster_20 = Cluster_2(ClusterInput=value_listener_11.Indices, data_for_json=cluster_2.data_for_json)
cluster_21 = Cluster_2(ClusterInput=value_listener_2.Indices, data_for_json=cluster_3.data_for_json)
cluster_22 = Cluster_2(ClusterInput=value_listener_6.Indices, data_for_json=cluster_4.data_for_json)
cluster_23 = Cluster_2(ClusterInput=value_listener_7.Indices, data_for_json=cluster_11.data_for_json)
cluster_24 = Cluster_2(ClusterInput=value_listener_4.Indices, data_for_json=cluster_5.data_for_json)
cluster_25 = Cluster_2(ClusterInput=value_listener_3.Indices, data_for_json=cluster_12.data_for_json)
cluster_26 = Cluster_2(ClusterInput=value_listener_5.Indices, data_for_json=cluster_15.data_for_json)
cluster_27 = Cluster_2(ClusterInput=value_listener_19.Indices, data_for_json=cluster_14.data_for_json)
cluster_28 = Cluster_2(ClusterInput=value_listener_27.Indices, data_for_json=cluster_8.data_for_json)
cluster_29 = Cluster_2(ClusterInput=value_listener_8.Indices, data_for_json=cluster_13.data_for_json)
cluster_30 = Cluster_2(ClusterInput=value_listener_17.Indices, data_for_json=cluster_7.data_for_json)
entwine = Entwine(
    Branch00="\"SuperOffice:1\":",
    Branch01="\"SuperOffice:2\":",
    Branch02="\"SuperOffice:7\":",
    Branch03="\"SuperOffice:43\":",
    Branch04="\"SuperOffice:3\":",
    Branch05="\"SuperOffice:4\":",
    Branch06="\"SuperOffice:5\":",
    Branch07="\"SuperOffice:6\":",
    Branch08="\"SuperOffice:35\":",
    Branch09="\"SuperOffice:36\":",
    Branch010="\"SuperOffice:8\":",
    Branch011="\"SuperOffice:44\":",
    Branch012="\"SuperOffice:41\":",
    Branch013="\"SuperOffice:18\": ",
    Branch014="\"SuperOffice:9\": ",
    Branch015="\"SuperOffice:10\": ",
    Branch016="\"SuperOffice:11\": ",
    Branch017="\"SuperOffice:12\": ",
    Branch018="\"SuperOffice:34\":",
    Branch019="\"SuperOffice:17\":",
    Branch020="\"SuperOffice:21\":",
    Branch021="\"SuperOffice:16\":",
    Branch022="\"SuperOffice:15\":",
    Branch023="\"SuperOffice:14\":",
    Branch024="\"SuperOffice:13\":",
    Branch025="\"SuperOffice:40\":",
    Branch026="\"SuperOffice:27\":",
    Branch027="\"SuperOffice:28\":",
    Branch028="\"SuperOffice:19\":",
    Branch029="\"SuperOffice:42\":",
    Branch030="\"SuperOffice:45\":",
    FlattenInputs=True)
concatenate_2 = Concatenate(Fragment_A="\"", Fragment_B=value_listener_31.Values, A="\",")  # -> flatten(Result)
concatenate_3 = Concatenate(Fragment_A="\"", Fragment_B=value_listener_13.Values, A="\",")  # -> flatten(Result)
concatenate_4 = Concatenate(Fragment_A="\"", Fragment_B=value_listener_32.Values, A="\",")  # -> flatten(Result)
concatenate_5 = Concatenate(Fragment_A="\"", Fragment_B=value_listener_20.Values, A="\",")  # -> flatten(Result)
concatenate_6 = Concatenate(Fragment_A="\"", Fragment_B=value_listener_21.Values, A="\",")  # -> flatten(Result)
concatenate_7 = Concatenate(Fragment_A="\"", Fragment_B=value_listener_28.Values, A="\",")  # -> flatten(Result)
concatenate_8 = Concatenate(Fragment_A="\"", Fragment_B=value_listener_29.Values, A="\",")  # -> flatten(Result)
concatenate_9 = Concatenate(Fragment_A="\"", Fragment_B=value_listener_18.Values, A="\",")  # -> flatten(Result)
concatenate_10 = Concatenate(Fragment_A="\"", Fragment_B=value_listener_24.Values, A="\",")  # -> flatten(Result)
concatenate_11 = Concatenate(Fragment_A="\"", Fragment_B=value_listener_25.Values, A="\",")  # -> flatten(Result)
concatenate_12 = Concatenate(Fragment_A="\"", Fragment_B=value_listener_15.Values, A="\",")  # -> flatten(Result)
concatenate_13 = Concatenate(Fragment_A="\"", Fragment_B=value_listener_16.Values, A="\",")  # -> flatten(Result)
concatenate_14 = Concatenate(Fragment_A="\"", Fragment_B=value_listener_23.Values, A="\",")  # -> flatten(Result)
concatenate_15 = Concatenate(FragmentA="I:", FragmentB=value_listener_22.Values)
concatenate_16 = Concatenate(FragmentA="I:", FragmentB=value_listener_30.Values)
panel_5 = Panel(entwine)
concatenate_17 = Concatenate(Fragment_A="\"[", Fragment_B=cluster_25, A="]\",")
concatenate_18 = Concatenate(Fragment_A="\"[", Fragment_B=cluster_24, A="]\",")
concatenate_19 = Concatenate(Fragment_A="\"[", Fragment_B=cluster_26, A="]\",")
concatenate_20 = Concatenate(Fragment_A="\"[", Fragment_B=cluster_29, A="]\",")
concatenate_21 = Concatenate(Fragment_A="\"[", Fragment_B=cluster_22, A="]\",")
concatenate_22 = Concatenate(Fragment_A="\"[", Fragment_B=cluster_30, A="]\",")
concatenate_23 = Concatenate(Fragment_A="\"[", Fragment_B=concatenate_15, A="]\",")
concatenate_24 = Concatenate(Fragment_A="\"[", Fragment_B=cluster_28, A="]\",")
concatenate_25 = Concatenate(Fragment_A="\"[", Fragment_B=cluster_23, A="]\",")
concatenate_26 = Concatenate(Fragment_A="\"[", Fragment_B=concatenate_16, A="]\",")
concatenate_27 = Concatenate(Fragment_A="\"[", Fragment_B=cluster_27, A="]\",")
concatenate_28 = Concatenate(Fragment_A="\"[", Fragment_B=cluster_20, A="]\",")
concatenate_29 = Concatenate(Fragment_A="\"[", Fragment_B=cluster_18, A="]\",")
concatenate_30 = Concatenate(Fragment_A="\"[", Fragment_B=cluster_19, A="]\",")
concatenate_31 = Concatenate(Fragment_A="\"[", Fragment_B=cluster_21, A="]\",")
concatenate_32 = Concatenate(Fragment_A="\"[", Fragment_B=cluster_17, A="]\",")
concatenate_33 = Concatenate(Fragment_A="\"[", Fragment_B=concatenate, A="]\",")
concatenate_34 = Concatenate(Fragment_A="\"[", Fragment_B=cluster_16, A="]\",")
# For Træskuffetype and the rest the order is kept just in GUI, it doesn't have to be kept for the JSON PATCH
merge_4 = Merge(
    Data1=concatenate_34,
    Data2=concatenate_32,
    Data3=concatenate_29,
    Data4=concatenate_30,
    Data5=concatenate_28,
    Data6=concatenate_31,
    Data7=concatenate_21,
    Data8=concatenate_25,
    Data9=concatenate_18,
    Data10=concatenate_17,
    Data11=concatenate_19,
    Data12=concatenate_20)
merge_5 = Merge(Data1=concatenate_33, Data2=merge_4)  # -> flatten(Result)
entwine_2 = Entwine(
    Branch00=merge_5,
    Branch01=concatenate_3,
    Branch02=concatenate_5,
    Branch03=concatenate_9,
    Branch04=concatenate_6,
    Branch05=concatenate_12,
    Branch06=concatenate_13,
    Branch07=concatenate_22,
    Branch08=concatenate_23,
    Branch09=concatenate_14,
    Branch010=concatenate_10,
    Branch011=concatenate_11,
    Branch012=concatenate_7,
    Branch013=concatenate_8,
    Branch014=concatenate_26,
    Branch015=concatenate_2,
    Branch016=concatenate_4,
    Branch017=concatenate_27,
    Branch018=concatenate_24,
    FlattenInputs=True)  # -> flatten(Result)
concatenate_35 = Concatenate(FragmentB=flatten(panel_5), FragmentA=entwine_2)  # -> flatten(Result)
panel_6 = Panel(entwine_2)
entwine_3 = Entwine(Branch00="{\"UserDefinedFields\": {", Branch01=concatenate_35, Branch02="}}", FlattenInputs=True)  # -> flatten(Result)
weave = Weave(Pattern=[0, 1], NullGaps=False)
# The most important thing is how to put the declared values into one JSON string to be sent to SUO ?
merge_6 = Merge()
characters = Characters(Text=entwine_3)  # -> flatten(Result), Unicode
entwine_4 = Entwine(FlattenInputs=True)
text_join = TextJoin(Text=characters.Result)
format_json_string = FormatJsonString(JSONString=text_join)
panel_7 = Panel(format_json_string)
create_text_body_custom = CreateTextBodyCustom(Content=panel_7, ContentType="application/json")
patch_request = PATCHRequest(
    URL="https://online4.superoffice.com/Cust29326/api/v1/Sale/8667",
    Body=create_text_body_custom,
    Params=create_query_param,
    Headers=bearer_token_auth)  # -> Status, Content, Response
panel_8 = Panel(patch_request.Status)
format_json_string_2 = FormatJsonString(JSONString=patch_request.Content)
panel_9 = Panel(format_json_string_2)

# ==== cluster Cluster
input_list_data = ClusterInput()
text_split = TextSplit(Text=input_list_data, Separators=";")
panel = Panel(text_split)
split_list = SplitList(List=text_split, Index=Slider(1, range=0..100))  # -> flatten(ListA), flatten(ListB)
panel_2 = Panel(split_list.ListA)
data_for_json = ClusterOutput(split_list.ListB)
panel_3 = Panel(split_list.ListB)
text_for_user = ClusterOutput(split_list.ListA)

# ==== cluster Cluster_2
data_for_json = ClusterInput()
list_length = ListLength(List=data_for_json)
panel = Panel(ClusterInput())
series = Series(Start=Slider(0, range=0..100), Step=Slider(1, range=0..1), Count=list_length)
panel_2 = Panel(series)
replace_members = ReplaceMembers(Set=panel, Find=panel_2, Replace=data_for_json)
filtetred_data_for_json = ClusterOutput(replace_members)
