# Grasshopper definition GHtoSUO_add_records_to_sales.gh (Grasshopper 1.0.7)
# plug-ins: Swiftlet, Human UI

panel = Panel("""Messengers;I:122.
Morsø Fragtservice;I:123.
FTO;I:156.
BKN;I:157""")
panel_2 = Panel("""&SHUFL;I:40.
&SHUFL IHP;I:41.
IKEA IHP;I:42.
Kundens egen tegning;I:43.
Ingen;I:44""")
text_split = TextSplit(Text="Tegning.Farve.Kollektion", Separators=".")
text_split_2 = TextSplit(Text=panel_2, Separators=".")
text_split_3 = TextSplit(Text=panel, Separators=".")
launch_window = LaunchWindow(Show=Toggle(True), Name="Control Window", Width=370, Height=400, ChildStatus=0, EnableHorizScroll=False)
# How to make it possible that to Farve is going different set?
create_pulldown_menu = CreatePulldownMenu(Label=text_split, ListItems=text_split_2, showLabel=True)
text_split_4 = TextSplit(Text=text_split_2, Separators=";")  # -> flatten(Result)
add_elements = AddElements(Window=launch_window, Elements=flatten(create_pulldown_menu), DoVLChecking=True)  # -> AddedElements, ElementNames
value_listener = ValueListener(Elements=create_pulldown_menu, SomeProperty=True)  # -> Values, Indices
# Create a panel that can look like Sales/More in SUO.
# The names of entities are assigned with JSON ID of entity: example: SuperOffice:13
# The mapping is in the file
# In the panel you can choose for each entity a list of Colors/Material/etc.
# There are files translating each color to ID for JSON, each entity has its file, some entities use same file.
panel_3 = Panel("\"SuperOffice:1\":")
panel_4 = Panel(text_split_4)
concatenate = Concatenate(Fragment_A="\"[", Fragment_B="F:77.77", A="]\",")
# How to add more records to the JSON file string while choosing many entities simuntaneously?
# Programming logic ?(IF record THEN add)
panel_5 = Panel("""{
"UserDefinedFields": {""")
# The most important thing is how to put the declared values into one JSON string to be sent to SUO ?
panel_6 = Panel(""" }
}""")
concatenate_2 = Concatenate(Fragment_A=panel_5, Fragment_B=panel_3, A=concatenate, B=panel_6)
panel_7 = Panel(concatenate_2)
panel_8 = Panel("""{
  "UserDefinedFields": {
    "SuperOffice:1": "[F:44.33]"
  }
}""")
bearer_token_auth = BearerTokenAuth(Token="8A:Cust29326.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")
create_text_body_custom = CreateTextBodyCustom(Content=concatenate_2, ContentType="application/json")
create_query_param = CreateQueryParam(Key="$select", Value="UserDefinedFields")
patch_request = PATCHRequest(
    URL="https://online4.superoffice.com/Cust29326/api/v1/Sale/8667",
    Body=create_text_body_custom,
    Params=create_query_param,
    Headers=bearer_token_auth)  # -> Status, Content, Response
panel_9 = Panel(patch_request.Status)
format_json_string = FormatJsonString(JSONString=patch_request.Content)
panel_10 = Panel(format_json_string)
