# Grasshopper definition TEST METAHOPPER.gh (Grasshopper 1.0.7)
# plug-ins: Human UI

create_button = CreateButton(ButtonName="SEND", ButtonStyle=0)
create_text_box = CreateTextBox(Label="TEST1", UpdateButton=True, showLabel=True)
create_text_box_2 = CreateTextBox(Label="TEST2", UpdateButton=True, showLabel=True)
value_listener = ValueListener(Elements=create_button, SomeProperty=True)  # -> Values, Indices
launch_window = LaunchWindow(Show=Toggle(True), Name="Control Window", Width=370, Height=400, ChildStatus=2, EnableHorizScroll=False)
entwine = Entwine(Branch00=create_text_box, Branch01=create_text_box_2, Branch02=create_button, FlattenInputs=True)
value_listener_2 = ValueListener(Elements=create_text_box, SomeProperty=True)  # -> Values, Indices
value_listener_3 = ValueListener(Elements=create_text_box_2, SomeProperty=True)  # -> Values, Indices
add_elements = AddElements(Window=launch_window, Elements=flatten(entwine), DoVLChecking=True)  # -> AddedElements, ElementNames
panel = Panel(value_listener.Values)
panel_2 = Panel(value_listener_3.Values)
panel_3 = Panel(value_listener_2.Values)
